# Dynamo graph Ceiling_Mesh Aprch02_GR_1.0.0.dyn (Dynamo 2.3.0.5885)
# packages: MeshToolkit 3.0.0, Landform 2016.10.13, spring nodes 204.1.0, Genius Loci 2021.9.7

# group: Mesh Import
mesh = Filename("..\Ceiling\Pena\Cupula\Mesh_georef_FINAL.obj")  # graph input
importFile = Autodesk.Dynamo.MeshToolkit.Mesh.ImportFile(fileName=mesh)

# group: Mesh Translation
get_project_locations = Custom[Get Project Locations]()  # package Genius Loci; Works only in Revit 2018 and later. Retrieves the project positions of the given document in the Survey Coordinate System. (Coordinates of Internal origin, project base point and survey point)
byTwoPoints = Vector.ByTwoPoints(start=get_project_locations.Internal_Origin, end=get_project_locations.Project_Survey_Point)
translate = Autodesk.Dynamo.MeshToolkit.Mesh.Translate(mesh=importFile, vector=byTwoPoints)

# group: Mesh Reduction
triangleCount = Autodesk.Dynamo.MeshToolkit.Mesh.TriangleCount(mesh=translate)
triangle_reduction = DoubleSlider(25, range=0..100 step 1)  # graph input
code_block = CodeBlock(y=triangle_reduction) { x=y*0.01; }
code_block_2 = CodeBlock(x=triangleCount, y=code_block) { z=x-y*x; }
reduce = Autodesk.Dynamo.MeshToolkit.Mesh.Reduce(mesh=translate, triangleCount=code_block_2)

# group: Base profile selection
vertices = Autodesk.Dynamo.MeshToolkit.Mesh.Vertices(mesh=reduce)
byGeometry = BoundingBox.ByGeometry(geom=vertices)
toPolySurface = BoundingBox.ToPolySurface(boundingBox=byGeometry)
doesIntersect = Geometry.DoesIntersect(geometry=toPolySurface, other=vertices, lacing=Longest)
filterByBoolMask = List.FilterByBoolMask(list=vertices, mask=doesIntersect)
flatten = List.Flatten(list=filterByBoolMask.in)
surfaces = PolySurface.Surfaces(polySurface=toPolySurface)
flatten_2 = List.Flatten(list=surfaces)
normalAtParameter = Surface.NormalAtParameter(surface=flatten_2)
isParallel = Vector.IsParallel(vector=normalAtParameter, other=normalAtParameter, lacing=CrossProduct)
firstItem = List.FirstItem(list=isParallel)
filterByBoolMask_2 = List.FilterByBoolMask(list=flatten_2@L2, mask=firstItem)
flatten_3 = List.Flatten(list=filterByBoolMask_2.out)
doesIntersect_2 = Geometry.DoesIntersect(geometry=flatten@L2, other=flatten_3, lacing=Longest)
code_block_3 = CodeBlock { true; }
indexOf = List.IndexOf(list=doesIntersect_2@L2, element=code_block_3)
getItemAtIndex = List.GetItemAtIndex(list=flatten, index=indexOf)
XYZ = Custom[Point.XYZ](point=getItemAtIndex)  # package Landform; Get the X, Y, and Z components of a Point
Z = Point.Z(point=getItemAtIndex)
minimumItem = List.MinimumItem(list=Z)
byCoordinates = Point.ByCoordinates(x=XYZ.X, y=XYZ.Y, z=minimumItem)
boolean = BoolSelector(true)
byPoints = PolyCurve.ByPoints(points=byCoordinates, connectLastToFirst=boolean)
ZAxis = Vector.ZAxis()
code_block_4 = CodeBlock { -0.2; }
code_block_5 = CodeBlock { 0.05; }
boolean_2 = BoolSelector(false)

translate_2 = Geometry.Translate(geometry=byPoints, direction=ZAxis, distance=code_block_4)

# group (continued): Base profile selection
offset = PolyCurve.Offset(polyCurve=translate_2, signedDistance=code_block_5, extendCircular=boolean_2)
byJoinedCurves = PolyCurve.ByJoinedCurves(curves=offset)

# group: Get Z-axis profiles
firstItem_2 = List.FirstItem(list=byCoordinates)
byOriginNormal = Plane.ByOriginNormal(origin=firstItem_2)
Z_2 = Point.Z(point=firstItem_2)
Z_3 = Point.Z(point=flatten)
maximumItem = List.MaximumItem(list=Z_3)
code_block_6 = CodeBlock(x=maximumItem, y=Z_2) { x-y; }
number_of_sections_z_axis = IntegerSlider(8, range=0..20 step 1)  # graph input
code_block_7 = CodeBlock(x=code_block_6, y=number_of_sections_z_axis) { x/y; }
range = Range(start=Z_2, end=maximumItem, step=code_block_7)
code_block_8 = CodeBlock { 0; }
removeItemAtIndex = List.RemoveItemAtIndex(list=range, indices=code_block_8)
code_block_9 = CodeBlock(x=removeItemAtIndex, y=Z_2) { x-y; }
offset_2 = Plane.Offset(plane=byOriginNormal, dist=code_block_9)
intersect = Autodesk.Dynamo.MeshToolkit.Mesh.Intersect(mesh=reduce, intersectionPlane=offset_2, lacing=Longest)

# group: Profiles simplification
list_create = List.Create(item0=byJoinedCurves, item1=byPoints, item2=intersect)
flatten_4 = List.Flatten(list=list_create)
curves = PolyCurve.Curves(polyCurve=flatten_4)
count = List.Count(list=curves@L2)
code_block_10 = CodeBlock(x=count) { x>=4; }
filterByBoolMask_3 = List.FilterByBoolMask(list=curves, mask=code_block_10)
endPoint = Curve.EndPoint(curve=filterByBoolMask_3.in)
startPoint = Curve.StartPoint(curve=filterByBoolMask_3.in)
list_create_2 = List.Create(item0=endPoint, item1=startPoint)
transpose = List.Transpose(lists=list_create_2)
flatten_5 = List.Flatten(list=transpose@L3)
pruneDuplicates = Point.PruneDuplicates(points=flatten_5)
distanceTo = Geometry.DistanceTo(geometry=pruneDuplicates, other=byCoordinates, lacing=CrossProduct)
minimumItem_2 = List.MinimumItem(list=distanceTo)
indexOf_2 = List.IndexOf(list=distanceTo@L2, element=minimumItem_2@@L1)
getItemAtIndex_2 = List.GetItemAtIndex(list=pruneDuplicates@L2, index=indexOf_2@L2)
boolean_3 = BoolSelector(true)
byPoints_2 = PolyCurve.ByPoints(points=getItemAtIndex_2, connectLastToFirst=boolean_3)

# group: Top Height
Z_4 = Point.Z(point=vertices)
maximumItem_2 = List.MaximumItem(list=Z_4)
code_block_11 = CodeBlock(x=maximumItem_2) { x-0.012; }
code_block_12 = CodeBlock(x=Z_4, y=code_block_11) { x>y; }
filterByBoolMask_4 = List.FilterByBoolMask(list=vertices, mask=code_block_12)
byBestFitThroughPoints = Line.ByBestFitThroughPoints(bestFitPoints=filterByBoolMask_4.in)
code_block_13 = CodeBlock { [0.001,-0.001]; }
offset_3 = Curve.Offset(curve=byBestFitThroughPoints, distance=code_block_13, lacing=CrossProduct)
flatten_6 = List.Flatten(list=offset_3)
code_block_14 = CodeBlock(c=flatten_6) { c[0]; c[1]; }
endPoint_2 = Curve.EndPoint(curve=code_block_14.out0)
endPoint_3 = Curve.EndPoint(curve=code_block_14.out1)
startPoint_2 = Curve.StartPoint(curve=code_block_14.out1)
startPoint_3 = Curve.StartPoint(curve=code_block_14.out0)
list_create_3 = List.Create(item0=endPoint_2, item1=endPoint_3, item2=startPoint_2, item3=startPoint_3)
boolean_4 = BoolSelector(true)
byPoints_3 = PolyCurve.ByPoints(points=list_create_3, connectLastToFirst=boolean_4)

# group: Top surface creation
list_create_4 = List.Create(item0=byPoints_2, item1=byPoints_3)
flatten_7 = List.Flatten(list=list_create_4)
byLoft = Solid.ByLoft(crossSections=flatten_7)

# group: Base surface creation
firstItem_3 = List.FirstItem(list=flatten_7)
ZAxis_2 = Vector.ZAxis()
reverse = Vector.Reverse(vector=ZAxis_2)
base_extension = DoubleSlider(0.27, range=0..1 step 0.01)  # graph input
translate_3 = Geometry.Translate(geometry=firstItem_3, direction=reverse, distance=base_extension)
list_create_5 = List.Create(item0=translate_3, item1=firstItem_3)
byLoft_2 = Surface.ByLoft(crossSections=list_create_5)

# group: Interior surface creation
explode = Geometry.Explode(geometry=byLoft)
byUnion = Surface.ByUnion(surfaces=explode)
byPatch = Surface.ByPatch(closedCurve=firstItem_3)
difference = Surface.Difference(surface=byUnion, others=byPatch)
list_create_6 = List.Create(item0=difference, item1=byLoft_2)

# group: Polysurface with thickness
byUnion_2 = Surface.ByUnion(surfaces=list_create_6)
thickness = DoubleSlider(0.1, range=0..0.25 step 0.01)  # graph input
offset_4 = Surface.Offset(surface=byUnion_2, distance=thickness)
offset_5 = Curve.Offset(curve=translate_3, distance=thickness)
byPatch_2 = Surface.ByPatch(closedCurve=offset_5)
byPatch_3 = Surface.ByPatch(closedCurve=translate_3)
difference_2 = Surface.Difference(surface=byPatch_2, others=byPatch_3)
list_create_7 = List.Create(item0=byUnion_2, item1=offset_4, item2=difference_2)
byJoinedSurfaces = PolySurface.ByJoinedSurfaces(surfaces=list_create_7)

# group: Model to Revit
byGeometry_2 = Autodesk.Dynamo.MeshToolkit.Mesh.ByGeometry(inputGeometry=byJoinedSurfaces)
ꟿ_tkmesh_tomesh = Custom[ꟿ TkMesh.ToMesh](tkMesh=byGeometry_2)  # package spring nodes; Attempts to convert a toolkit mesh to a Dynamo mesh. You obviously need to have the appropriate version of the mesh toolkit package downloaded first.
categories = Categories("OST_Ceilings")
material_name = StringInput("Pena Fresco")  # graph input
byName = Material.ByName(name=material_name)
family_name = StringInput("Pena - Ceiling 1")  # graph input
byMesh = DirectShape.ByMesh(mesh=ꟿ_tkmesh_tomesh, category=categories, material=byName, name=family_name)
