# Dynamo graph Floor-Floor_GR_1.0.0.dyn (Dynamo 2.3.0.5885)
# packages: Clockwork for Dynamo 1.x 1.0.2

# group: Inputs
seleção_sub_região = DSModelElementSelection()  # 1 picked in the model; graph input
seleção_do_piso = DSModelElementSelection()  # 1 picked in the model; graph input

# group: Points to Topography
points = Topography.Points(topography=seleção_sub_região)

# group: Revit Family output
slabShapeByPoints = Custom[Floor.SlabShapeByPoints](points=points, floor=seleção_do_piso)  # package Clockwork for Dynamo 1.x; Transform a slab shape based on a list of XYZs. PLEASE NOTE: Will reset any previous edits on the slab shape.
