# Dynamo graph Floor_step 2-Subregion_GR_0.1.2.dyn (Dynamo 2.3.0.5885)
# packages: spring nodes 204.1.0

# group: Inputs
select_floor = DSModelElementSelection()  # 1 picked in the model; graph input
select_topo = DSModelElementSelection()  # 1 picked in the model; graph input

# group: Create Subregion from Floor Sketch
ꟿ_collect_elementsketch = Custom[ꟿ Collect.ElementSketch](element=select_floor)  # package spring nodes; Get the actual sketch lines of a sketch based element (floor, ceiling, modified wall, etc.) . You can optionally fetch the matching model curves, however this might prove comptationally heavy on larger data sets. Does not work with elements from linked files.
python_script = Python(IN[0]=ꟿ_collect_elementsketch.curves, IN[1]=select_topo)
# ---------- python_script.python (52 lines) ----------
import clr

clr.AddReference('RevitAPI')
from Autodesk.Revit.DB import *
from Autodesk.Revit.DB.Architecture import *
import System.Collections.Generic
from System.Collections.Generic import List

clr.AddReference('RevitNodes')
import Revit
clr.ImportExtensions(Revit.GeometryConversion)

clr.AddReference('RevitServices')
from RevitServices.Transactions import TransactionManager
from RevitServices.Persistence import DocumentManager

doc = DocumentManager.Instance.CurrentDBDocument

# Get input variables
subregions = IN[0]
host = UnwrapElement(IN[1])

# Init variables
curveLoops = []
createdSubRegions = []
error = []

TransactionManager.Instance.EnsureInTransaction(doc)

# Get groups of curves (exploded polycurves!) and creates per group a SubRegion
for i in subregions:
	# Init CurveLoop for every curve group
	x = CurveLoop()
	
	# Iterate the seperate curves -> convert type to Revit Type -> add to CurveLoop
	for j in i:
		x.Append(j.ToRevitType())
	curveLoops.append(x)
	
	# Add layer to list
	y = [x]
	yI = List[CurveLoop](y)
	
	if SiteSubRegion.IsValidBoundary(yI):
		# Create SubRegion out of the CurveLoop group and add its to 'createdSubregions'
		newSubRegion = SiteSubRegion.Create(doc, yI, host.Id)
		createdSubRegions.append(newSubRegion)
	
TransactionManager.Instance.TransactionTaskDone()

# Output
OUT = createdSubRegions
# ----------------------------------------
