# Dynamo graph Pipes_GR_1.0.0.dyn (Dynamo 2.3.0.5885)
# packages: Sastrugi 2.0.0, MEPover 2020.6.2, Clockwork for Dynamo 1.x 1.0.2

# group: Inputs
number_of_points_in_point_cloud = DoubleSlider(84700, range=0..100000 step 100)  # graph input
level = Levels("Crawlspace")  # graph input
inches_true_millimeters_false = BoolSelector(false)  # graph input

# group: Point Cloud Selection
boolean = BoolSelector(false)
pointcloud_select_points_in_view = Custom[❄_Pointcloud Select Points in View](PointSampleSize=number_of_points_in_point_cloud, Refresh=boolean)  # package Sastrugi; (Sastrugi_Pointcloud_Geometry) This node allows users to select a specific number of Pointcloud Points by creating a selection region in the Active View.

# group: Selection of points from the pipe profiles at the beginning and end of the pipeline
byBestFitThroughPoints = Line.ByBestFitThroughPoints(bestFitPoints=pointcloud_select_points_in_view.Points)
code_block = CodeBlock { 100; }
code_block_2 = CodeBlock(a=code_block) { [a,-a]; [0,1]; 1; }
pointAtChordLength = Curve.PointAtChordLength(curve=byBestFitThroughPoints, chordLength=code_block_2.out0@L2, parameterLocation=code_block_2.out1@L2, lacing=Longest)
parameterAtPoint = Curve.ParameterAtPoint(curve=byBestFitThroughPoints, point=pointAtChordLength, lacing=Longest)
coordinateSystemAtParameter = Curve.CoordinateSystemAtParameter(curve=byBestFitThroughPoints, param=parameterAtPoint, lacing=Longest)
code_block_3 = CodeBlock { 200; 100; 200; }
byLengths = Cuboid.ByLengths(cs=coordinateSystemAtParameter, width=code_block_3.out0, length=code_block_3.out1, height=code_block_3.out2)
flatten = List.Flatten(list=byLengths)
doesIntersect = Geometry.DoesIntersect(geometry=flatten, other=pointcloud_select_points_in_view.Points, lacing=CrossProduct)
filterByBoolMask = List.FilterByBoolMask(list=pointcloud_select_points_in_view.Points, mask=doesIntersect@L2)
flatten_2 = List.Flatten(list=filterByBoolMask.in@L2)

# group: Location of the central axis of the pipeline
byBestFit = Sphere.ByBestFit(points=flatten_2)
centroid = Solid.Centroid(solid=byBestFit)
code_block_4 = CodeBlock(point=centroid) { point[0]; point[1]; }
byStartPointEndPoint = Line.ByStartPointEndPoint(startPoint=code_block_4.out0, endPoint=code_block_4.out1)
extendStart = Curve.ExtendStart(curve=byStartPointEndPoint, distance=code_block)
extendEnd = Curve.ExtendEnd(curve=extendStart, distance=code_block)

# group: Measurement of the pipe diameter
python_script = Python()  # unwired: IN[0]
# ---------- python_script.python (67 lines) ----------
import clr
clr.AddReference('ProtoGeometry')
from Autodesk.DesignScript.Geometry import *

# Import DocumentManager and TransactionManager
clr.AddReference("RevitServices")
import RevitServices
from RevitServices.Persistence import DocumentManager
from RevitServices.Transactions import TransactionManager

# Import python library
import sys
pyt_path = r'C:\Program Files (x86)\IronPython 2.7\Lib'
sys.path.append(pyt_path)
import os
import shutil

#Import Data and Time
from datetime import datetime
now = datetime.now()

# Import math library
from math import *

# Import RevitAPI
clr.AddReference("RevitAPI")
import Autodesk
from Autodesk.Revit.DB import *

# Import Element nodes in Dynamo
clr.AddReference("RevitNodes")
import Revit
clr.ImportExtensions(Revit.Elements)

# Import DSCore nodes in Dynamo
clr.AddReference('DSCoreNodes')
import DSCore
from DSCore import *

#Import System Library
import System
from System.Collections.Generic import *
from System.IO import Directory, Path

doc = DocumentManager.Instance.CurrentDBDocument
uiapp = DocumentManager.Instance.CurrentUIApplication
app = uiapp.Application

segments = FilteredElementCollector(doc).OfCategory(BuiltInCategory.OST_PipeSegments).ToElements()

norminal,name = [],[]

#Preparing input from dynamo to revit
for seg in segments:
	sizes = seg.GetSizes()
	name.append(seg.Name)
	temp = []
	for size in sizes:
		temp.append(size.NominalDiameter * 304.8)
	norminal.append(temp)
#Do some action in a Transaction
TransactionManager.Instance.EnsureInTransaction(doc)

TransactionManager.Instance.TransactionTaskDone()

#Final output
OUT = norminal,name
# ----------------------------------------
firstItem = List.FirstItem(list=python_script@L3, lacing=Shortest)
firstItem_2 = List.FirstItem(list=firstItem)
distanceTo = Geometry.DistanceTo(geometry=pointcloud_select_points_in_view.Points, other=extendEnd)
average = Math.Average(numbers=distanceTo)
code_block_5 = CodeBlock { 5; }
roundDownToPrecision = Custom[Math.RoundDownToPrecision](dbl=average, precision=code_block_5)  # package Clockwork for Dynamo 1.x; Rounds a number *down* to a specified precision
code_block_6 = CodeBlock(r=roundDownToPrecision) { d=r*2; }
code_block_7 = CodeBlock(X=code_block_6, y=firstItem_2) { X-y; }
abs = Math.Abs(number=code_block_7)
minimumItem = List.MinimumItem(list=abs)
indexOf = List.IndexOf(list=abs, element=minimumItem)
getItemAtIndex = List.GetItemAtIndex(list=firstItem_2, index=indexOf)

# group: Unit Conversion
convert_between_units = DynamoConvert(getItemAtIndex, MeasurementType="Length", FromConversion="Millimeters", ToConversion="Inches")
list_create = List.Create(item0=convert_between_units, item1=getItemAtIndex)
code_block_8 = CodeBlock { 0; 1; }
if_ = If(test=inches_true_millimeters_false, true=code_block_8.out0, false=code_block_8.out1)
getItemAtIndex_2 = List.GetItemAtIndex(list=list_create, index=if_)

# group: BIM element modeling
element_types = ElementTypes("PipeType")
all_elements_of_type = ElementsOfType(element_type=element_types)
element_types_2 = ElementTypes("PipingSystemType")
all_elements_of_type_2 = ElementsOfType(element_type=element_types_2)
code_block_9 = CodeBlock(type1=all_elements_of_type, type2=all_elements_of_type_2) { type1[0]; type2[0]; }
byLines = Custom[Pipe.ByLines](Lines=extendEnd, PipeType=code_block_9.out0, SystemType=code_block_9.out1, level=level, Diameter=getItemAtIndex_2)  # package MEPover; Creates a pipe by Line, PipeType, SystemType, Level and Diameter
