# Dynamo graph Profile_GR_0.1.2.dyn (Dynamo 2.3.0.5885)
# packages: Sastrugi 2.0.0, archi-lab.net 2020.23.10, SteamNodes 1.2.4, LunchBox for Dynamo 2018.7.6, Landform 2016.10.13, Data-Shapes 2022.2.96, Clockwork for Dynamo 1.x 1.0.2

# group: User Interface
code_block = CodeBlock { "Profile Detection"; "Run Script"; "https://github.com/gustavomrocha85/dynamo"; "Cancel"; 200; }
code_block_2 = CodeBlock { "Keyword for family name filter"; "Instructions"; }
textbox_data = Custom[TextBox Data](InputName=code_block_2.out0)  # package Data-Shapes; Create Data for TextBox input in UI.MultipleInputForm ++ . Check out www.data-shapes.net for more informations
code_block_3 = CodeBlock()
# ---------- code_block_3.designscript (6 lines) ----------
"1. The measurement units in Revit should be set to millimeters (mm);

2. When selecting points, it is important to avoid selecting points that do not correspond to the desired profile points. This helps to improve performance and accuracy;

3. To increase performance and avoid searching the entire profile family database, it is recommended to filter profiles by family name using a keyword.
";
# ----------------------------------------
textnote_data = Custom[TextNote Data](Title=code_block_2.out1, TextNote=code_block_3)  # package Data-Shapes; Create Data for TextNote input in UI.MultipleInputForm ++ . Check out www.data-shapes.net for more informations
list_create = List.Create(item0=textbox_data, item1=textnote_data)
boolean = BoolSelector(true)
multipleinputform = Custom[MultipleInputForm ++](Description_optional=code_block.out0, ButtonText_optional=code_block.out1, Inputs=list_create, Toggle=boolean, LinkToHelp_optional=code_block.out2, CancelButtonText_optional=code_block.out3, LabelWidth_optional=code_block.out4)  # package Data-Shapes; Create a form with multiple inputs. see www.data-shapes.net for tutorials and infos!

# group: Point Cloud Selection
code_block_4 = CodeBlock { 10000; }
boolean_2 = BoolSelector(true)
pointcloud_select_points_in_view = Custom[❄_Pointcloud Select Points in View](PointSampleSize=code_block_4, Refresh=boolean_2)  # package Sastrugi; (Sastrugi_Pointcloud_Geometry) This node allows users to select a specific number of Pointcloud Points by creating a selection region in the Active View.
points = List.Create(item0=pointcloud_select_points_in_view.Points)
byGeometry = BoundingBox.ByGeometry(geom=points)
toCuboid = BoundingBox.ToCuboid(boundingBox=byGeometry)
centroid = Solid.Centroid(solid=toCuboid)
plane = List.Create(item0=pointcloud_select_points_in_view.BestFitPlane)

passthrough = Custom[Passthrough](passThrough=multipleinputform.User_Inputs, waitFor=pointcloud_select_points_in_view.Points)  # package Clockwork for Dynamo 1.x; Forces a sequential order of execution. The node wired into the output of the Passthrough node will be executed *after* the node wired into the waitFor input (e.g. important for some Revit operations). The value of the passThrough input will be passed on to the node wired into the output port of the Passthrough node.

# group: Profile selection
python_script_profile = Python()  # unwired: IN[0]
# ---------- python_script_profile.python (44 lines) ----------
# Copyright(c) 2017, Konrad K Sobon
# @arch_laboratory, http://archi-lab.net
#MA just changed cat list to include profiles...

import clr
clr.AddReference("RevitNodes")
import Revit
clr.ImportExtensions(Revit.Elements)

clr.AddReference("RevitServices")
import RevitServices
from RevitServices.Persistence import DocumentManager
doc = DocumentManager.Instance.CurrentDBDocument

# Import RevitAPI
clr.AddReference("RevitAPI")
from Autodesk.Revit.DB import *

import System
from System import Array
from System.Collections.Generic import *

import sys
pyt_path = r'C:\Program Files (x86)\IronPython 2.7\Lib'
sys.path.append(pyt_path)

try:
    errorReport = None
    
    cat_list = [BuiltInCategory.OST_ProfileFamilies]
    typed_list = List[BuiltInCategory](cat_list)
    filter = ElementMulticategoryFilter(typed_list)
    output = FilteredElementCollector(doc).WherePasses(filter).ToElements()

except:
    # if error occurs anywhere in the process catch it
    import traceback
    errorReport = traceback.format_exc()

# Assign your output to the OUT variable
if None == errorReport:
    OUT = output
else:
    OUT = errorReport
# ----------------------------------------
string_from_object = FromObject(obj=python_script_profile)
contains = String.Contains(str=string_from_object, searchFor=passthrough, lacing=Longest)
filterByBoolMask = List.FilterByBoolMask(list=python_script_profile, mask=contains)
transpose = List.Transpose(lists=filterByBoolMask.in@L1)
python_script = Python(IN[0]=transpose)
# ---------- python_script.python (50 lines) ----------
import clr
clr.AddReference('ProtoGeometry')
from Autodesk.DesignScript.Geometry import *

# Import ToDSType(bool) extension method
clr.AddReference("RevitNodes")
import Revit
clr.ImportExtensions(Revit.Elements)

# Import DocumentManager and TransactionManager
clr.AddReference("RevitServices")
import RevitServices
from RevitServices.Persistence import DocumentManager
from RevitServices.Transactions import TransactionManager

from System.Collections.Generic import *

# Import RevitAPI
clr.AddReference("RevitAPI")
import Autodesk
from Autodesk.Revit.DB import *

doc = DocumentManager.Instance.CurrentDBDocument
uiapp = DocumentManager.Instance.CurrentUIApplication
app = uiapp.Application

def Action(e):
    type = UnwrapElement(e.Family.Name)
    name = UnwrapElement(e.Name)

    family = UnwrapElement(e).Family

    TransactionManager.Instance.ForceCloseTransaction()
    famDoc = doc.EditFamily(family)

    famCollector = FilteredElementCollector(famDoc)
    sketch = famCollector.OfClass(Sketch)

    for i in sketch:
        cArray = list(i.Profile)
    cArray[:] = [[Revit.GeometryConversion.RevitToProtoCurve.ToProtoType(y, True ) for y in x] for x in cArray]
    return cArray

OUT = []

for i in IN[0]:
    a = []
    for k in i:
        a.append(Action(k))
    OUT.append(a)
# ----------------------------------------
byJoinedCurves = PolyCurve.ByJoinedCurves(curves=python_script)
byGeometry_2 = BoundingBox.ByGeometry(geom=byJoinedCurves)
clear_list = Custom[Clear List](input=byGeometry_2)  # package archi-lab.net; This node will remove all Null and Empty Lists from any list.
toCuboid_2 = BoundingBox.ToCuboid(boundingBox=clear_list)
centroid_2 = Solid.Centroid(solid=toCuboid_2)

# group: Profile Translate
byTwoPoints = Vector.ByTwoPoints(start=centroid_2@L2, end=centroid)
translate = Geometry.Translate(geometry=byJoinedCurves, direction=byTwoPoints)
YAxis = Vector.YAxis()
code_block_5 = CodeBlock { 90; }
rotate = Geometry.Rotate(geometry=translate, origin=centroid, axis=YAxis, degrees=code_block_5, lacing=Longest)
XAxis = Vector.XAxis()
rotate_2 = Geometry.Rotate(geometry=rotate, origin=centroid, axis=XAxis, degrees=code_block_5, lacing=Longest)

# group: Profile Rotation
ZAxis = Vector.ZAxis()
normal = Plane.Normal(plane=plane)
basePlane = PolyCurve.BasePlane(polyCurve=rotate_2)
normal_2 = Plane.Normal(plane=basePlane)
angleWithVector = Vector.AngleWithVector(vector=normal, otherVector=normal_2)
code_block_6 = CodeBlock(y=angleWithVector) { x=180-y; }
list_create_2 = List.Create(item0=angleWithVector, item1=code_block_6)
flatten = List.Flatten(list=list_create_2)
rotate_3 = Geometry.Rotate(geometry=rotate_2@@L1, origin=centroid, axis=ZAxis, degrees=flatten@L2, lacing=Longest)
flatten_2 = List.Flatten(list=rotate_3@L4)
code_block_7 = CodeBlock { 180; }
rotate_4 = Geometry.Rotate(geometry=flatten_2@L4, origin=centroid, axis=ZAxis, degrees=code_block_7)

# group: Average accuracy calculation
distanceTo = Geometry.DistanceTo(geometry=points, other=rotate_4@L2)
average = Math.Average(numbers=distanceTo)
distanceTo_2 = Geometry.DistanceTo(geometry=points, other=flatten_2@L2)
average_2 = Math.Average(numbers=distanceTo_2)
list_create_3 = List.Create(item0=average, item1=average_2)
flatten_3 = List.Flatten(list=list_create_3@L3)

# group: Profile detection
code_block_8 = CodeBlock(x=flatten_3) { x<25; }
filterByBoolMask_2 = List.FilterByBoolMask(list=filterByBoolMask.in, mask=code_block_8@L2)
flatten_4 = List.Flatten(list=filterByBoolMask_2.in)
isEmpty = List.IsEmpty(list=flatten_4)
code_block_9 = CodeBlock { ["No matching profile was found."]; }
runMe = Custom[Tool.RunMe](Boolean=isEmpty, ThingToDo=code_block_9)  # package SteamNodes; Use Boolean to perform an action
not_ = Not(x=isEmpty)
string_from_object_2 = FromObject(obj=flatten_4)
runMe_2 = Custom[Tool.RunMe](Boolean=not_, ThingToDo=string_from_object_2)
list_create_4 = List.Create(item0=runMe, item1=runMe_2)
removeNulls = Lists.Manage.RemoveNulls(Data=list_create_4@L1)
removeEmpty = Custom[List.RemoveEmpty](list=removeNulls.Cleaned)  # package Landform; Removes empty indices from a list.
flatten_5 = List.Flatten(list=removeEmpty)
boolean_3 = BoolSelector(true)
python_script_2 = Python(IN[0]=flatten_5, IN[1]=boolean_3)
# ---------- python_script_2.python (18 lines) ----------
import clr

clr.AddReference("System.Windows.Forms")
from System.Windows.Forms import Form,Label

def popup(text):
	form = Form()
	form.Width = 300
	form.Height = 100	
	label = Label()
	label.Text = text
	label.Width = 280
	label.Height = 70
	label.Parent = form	
	form.ShowDialog()
	
Text="\n".join(IN[0])
popup(Text)
# ----------------------------------------
