# Dynamo graph Structural Beam_GR_0.2.4 (no rotation).dyn (Dynamo 2.3.0.5885)
# packages: spring nodes 204.1.0, Landform 2016.10.13, Clockwork for Dynamo 1.x 1.0.2, Sastrugi 2.0.0

# group: INPUTS
amount_of_points = DoubleSlider(10000, range=0..20000 step 1000)  # graph input
endpoint_displacement = DoubleSlider(400, range=0..2000 step 1)  # graph input
level = Levels("Level 1")  # graph input
beam_family = FamilyTypes("M_Concrete-Rectangular Beam:215 x 255 mm")  # graph input

# group: Point Cloud Selection
boolean = BoolSelector(false)
pointcloud_select_points_in_view = Custom[❄_Pointcloud Select Points in View](PointSampleSize=amount_of_points, Refresh=boolean)  # package Sastrugi; (Sastrugi_Pointcloud_Geometry) This node allows users to select a specific number of Pointcloud Points by creating a selection region in the Active View.

# group: Noise and artifact reduction
code_block = CodeBlock { 100; }
ꟿ_geometry_groupbydistance = Custom[ꟿ Geometry.GroupByDistance](geometry=pointcloud_select_points_in_view.Points, margin=code_block)  # package spring nodes; Splits the list of geometry elements into groups if the distance between them is less than the provided margin.
flatten = List.Flatten(list=ꟿ_geometry_groupbydistance@L2)
count = List.Count(list=flatten@L2)
ꟿ_list_maxindex = Custom[ꟿ List.MaxIndex](list=count)  # package spring nodes; Gets the maximum index of a list. Good for use with floating point values
point_cloud_list_getitematindex = List.GetItemAtIndex(list=flatten, index=ꟿ_list_maxindex.idx)

# group: Profile Points selection
byBestFitThroughPoints = Line.ByBestFitThroughPoints(bestFitPoints=point_cloud_list_getitematindex)
code_block_2 = CodeBlock(a=endpoint_displacement) { [a,-a]; [0,1]; 1; }
pointAtChordLength = Curve.PointAtChordLength(curve=byBestFitThroughPoints, chordLength=code_block_2.out0@L2, parameterLocation=code_block_2.out1@L2, lacing=Longest)
parameterAtPoint = Curve.ParameterAtPoint(curve=byBestFitThroughPoints, point=pointAtChordLength, lacing=Longest)
coordinateSystemAtParameter = Curve.CoordinateSystemAtParameter(curve=byBestFitThroughPoints, param=parameterAtPoint, lacing=Longest)
code_block_3 = CodeBlock { 1000; 250; 1000; }
byLengths = Cuboid.ByLengths(cs=coordinateSystemAtParameter, width=code_block_3.out0, length=code_block_3.out1, height=code_block_3.out2)
flatten_2 = List.Flatten(list=byLengths)
doesIntersect = Geometry.DoesIntersect(geometry=flatten_2, other=point_cloud_list_getitematindex, lacing=CrossProduct)
filterByBoolMask = List.FilterByBoolMask(list=point_cloud_list_getitematindex, mask=doesIntersect@L2)
flatten_3 = List.Flatten(list=filterByBoolMask.in@L2)

# group: Getting the TOP Baseline
Z = Point.Z(point=flatten_3)
maximumItem = List.MaximumItem(list=Z)
upper_offset_n = DoubleSlider(10, range=0..100 step 1)
code_block_4 = CodeBlock(h=maximumItem, n=upper_offset_n) { h-n; }
code_block_5 = CodeBlock(x=Z, y=code_block_4) { x<y; }
filterByBoolMask_2 = List.FilterByBoolMask(list=flatten_3, mask=code_block_5)
byGeometry = BoundingBox.ByGeometry(geom=filterByBoolMask_2.in@L2)
toCuboid = BoundingBox.ToCuboid(boundingBox=byGeometry)
centroid = Solid.Centroid(solid=toCuboid)
XYZ = Custom[Point.XYZ](point=centroid)  # package Landform; Get the X, Y, and Z components of a Point
Z_2 = Point.Z(point=flatten_3)
maximumItem_2 = List.MaximumItem(list=Z_2)
byCoordinates = Point.ByCoordinates(x=XYZ.X, y=XYZ.Y, z=maximumItem_2)
code_block_6 = CodeBlock(point=byCoordinates) { point[0]; point[1]; }
byStartPointEndPoint = Line.ByStartPointEndPoint(startPoint=code_block_6.out0, endPoint=code_block_6.out1)
direction = Line.Direction(line=byStartPointEndPoint)
code_block_7 = CodeBlock(a=endpoint_displacement) { [-a,a]; }
translate = Geometry.Translate(geometry=byCoordinates, direction=direction, distance=code_block_7, lacing=Longest)
firstItem = List.FirstItem(list=translate@L2)
lastItem = List.LastItem(list=translate@L2)
byStartPointEndPoint_2 = Line.ByStartPointEndPoint(startPoint=firstItem, endPoint=lastItem)

# group: Center Baseline
byGeometry_2 = BoundingBox.ByGeometry(geom=flatten_3@L2)
toCuboid_2 = BoundingBox.ToCuboid(boundingBox=byGeometry_2)
centroid_2 = Solid.Centroid(solid=toCuboid_2)
code_block_8 = CodeBlock(point=centroid_2) { point[0]; point[1]; }
byStartPointEndPoint_3 = Line.ByStartPointEndPoint(startPoint=code_block_8.out0, endPoint=code_block_8.out1)

# group: Width Dimension
midPoint = Custom[Curve.MidPoint](curve=byStartPointEndPoint_3)  # package Landform; Get the midpoint along the Curve
parameterAtPoint_2 = Curve.ParameterAtPoint(curve=byStartPointEndPoint_3, point=midPoint, lacing=Longest)
coordinateSystemAtParameter_2 = Curve.CoordinateSystemAtParameter(curve=byStartPointEndPoint_3, param=parameterAtPoint_2, lacing=Longest)
code_block_9 = CodeBlock { 1000; 150; 25; }
length = Curve.Length(curve=byStartPointEndPoint_3)
byLengths_2 = Cuboid.ByLengths(cs=coordinateSystemAtParameter_2, width=code_block_9.out0, length=length, height=code_block_9.out2)
doesIntersect_2 = Geometry.DoesIntersect(geometry=byLengths_2, other=point_cloud_list_getitematindex, lacing=CrossProduct)
filterByBoolMask_3 = List.FilterByBoolMask(list=point_cloud_list_getitematindex, mask=doesIntersect_2@L2)
list_create = List.Create(item0=filterByBoolMask_3.in)
flatten_4 = List.Flatten(list=list_create@L2)
distanceTo = Geometry.DistanceTo(geometry=byStartPointEndPoint_3, other=flatten_4)
average = Math.Average(numbers=distanceTo)
code_block_10 = CodeBlock(n=average) { n*2; 5; }
roundToPrecision = Custom[Math.RoundToPrecision](dbl=code_block_10.out0, precision=code_block_10.out1)  # package Clockwork for Dynamo 1.x; Rounds a number to a specified precision

# group: Height Dimension
midPoint_2 = Custom[Curve.MidPoint](curve=byStartPointEndPoint_3)
parameterAtPoint_3 = Curve.ParameterAtPoint(curve=byStartPointEndPoint_3, point=midPoint_2, lacing=Longest)
coordinateSystemAtParameter_3 = Curve.CoordinateSystemAtParameter(curve=byStartPointEndPoint_3, param=parameterAtPoint_3, lacing=Longest)
code_block_11 = CodeBlock { 25; 150; 1000; }
length_2 = Curve.Length(curve=byStartPointEndPoint_3)
byLengths_3 = Cuboid.ByLengths(cs=coordinateSystemAtParameter_3, width=code_block_11.out0, length=length_2, height=code_block_11.out2)
doesIntersect_3 = Geometry.DoesIntersect(geometry=byLengths_3, other=point_cloud_list_getitematindex, lacing=CrossProduct)
filterByBoolMask_4 = List.FilterByBoolMask(list=point_cloud_list_getitematindex, mask=doesIntersect_3@L2)
list_create_2 = List.Create(item0=filterByBoolMask_4.in)
flatten_5 = List.Flatten(list=list_create_2@L2)
distanceTo_2 = Geometry.DistanceTo(geometry=byStartPointEndPoint_3, other=flatten_5)
average_2 = Math.Average(numbers=distanceTo_2)
code_block_12 = CodeBlock(n=average_2) { n*2; 5; }
roundToPrecision_2 = Custom[Math.RoundToPrecision](dbl=code_block_12.out0, precision=code_block_12.out1)

# group: Family Creation
width = Custom[Width](num=roundToPrecision)  # package spring nodes; Converts the input number(s) to string. You can optionally limit the number of digits.
height = Custom[Height](num=roundToPrecision_2)  # package spring nodes; Converts the input number(s) to string. You can optionally limit the number of digits.
flatten_6 = List.Flatten(list=height)
code_block_13 = CodeBlock(w=width, h=flatten_6) { w+" x "+h+ " mm"; "b"; "h"; }
ꟿ_elementtype_duplicate = Custom[ꟿ ElementType.Duplicate](elementType=beam_family, newName=code_block_13.out0)  # package spring nodes; Create duplicate element types. If the type exists, it will be appended instead.
setParameterByName = Element.SetParameterByName(element=ꟿ_elementtype_duplicate, parameterName=code_block_13.out1, value=roundToPrecision)
flatten_7 = List.Flatten(list=roundToPrecision_2)
setParameterByName_2 = Element.SetParameterByName(element=setParameterByName, parameterName=code_block_13.out2, value=flatten_7)
beamByCurve = StructuralFraming.BeamByCurve(curve=byStartPointEndPoint_2, level=level, structuralFramingType=setParameterByName_2)
code_block_14 = CodeBlock { "Cross-Section Rotation"; }
setParameterByName_3 = Element.SetParameterByName(element=beamByCurve, parameterName=code_block_14)  # unwired: value
