# Dynamo graph Structural Column_GR_0.2.4.dyn (Dynamo 2.3.0.5885)
# packages: Sastrugi 2.0.0, spring nodes 204.1.0, Landform 2016.10.13, Clockwork for Dynamo 1.x 1.0.2, LunchBox for Dynamo 2018.7.6

# group: Point Cloud Selection
code_block = CodeBlock { 10000; }
boolean = BoolSelector(true)
pointcloud_select_points_in_view = Custom[❄_Pointcloud Select Points in View](PointSampleSize=code_block, Refresh=boolean)  # package Sastrugi; (Sastrugi_Pointcloud_Geometry) This node allows users to select a specific number of Pointcloud Points by creating a selection region in the Active View.

# group: Noise and artifact reduction
code_block_2 = CodeBlock { 100; }
ꟿ_geometry_groupbydistance = Custom[ꟿ Geometry.GroupByDistance](geometry=pointcloud_select_points_in_view.Points, margin=code_block_2)  # package spring nodes; Splits the list of geometry elements into groups if the distance between them is less than the provided margin.
flatten = List.Flatten(list=ꟿ_geometry_groupbydistance@L2)
count = List.Count(list=flatten@L2)
ꟿ_list_maxindex = Custom[ꟿ List.MaxIndex](list=count)  # package spring nodes; Gets the maximum index of a list. Good for use with floating point values
point_cloud_list_getitematindex = List.GetItemAtIndex(list=flatten, index=ꟿ_list_maxindex.idx)

# group: INPUTS
top_level = Levels("Level 2")  # graph input
top_offset = DoubleSlider(750, range=0..5000 step 1)  # graph input
base_offset = DoubleSlider(2000, range=0..5000 step 1)  # graph input
base_level = Levels("Level 1")  # graph input
distance_inside_the_wall = DoubleSlider(200, range=0..300 step 1)  # graph input
rectangular_column = FamilyTypes("M_Concrete-Rectangular-Column:100 x 330mm")  # graph input

# group: Profile selection
byBestFitThroughPoints = Line.ByBestFitThroughPoints(bestFitPoints=point_cloud_list_getitematindex)
endPoint = Curve.EndPoint(curve=byBestFitThroughPoints)
startPoint = Curve.StartPoint(curve=byBestFitThroughPoints)
list_create = List.Create(item0=endPoint, item1=startPoint)
XYZ = Custom[Point.XYZ](point=list_create)  # package Landform; Get the X, Y, and Z components of a Point
elevation = Level.Elevation(level=top_level)
code_block_3 = CodeBlock(Top_offset=top_offset, Base_offset=base_offset) { Top_offset; Base_offset; }
elevation_2 = Level.Elevation(level=base_level)
code_block_4 = CodeBlock(TopElev=elevation, DistTop=code_block_3.Top_offset, BaseElev=elevation_2, DistBase=code_block_3.Base_offset)
# ---------- code_block_4.designscript (2 lines) ----------
[TopElev-DistTop,
BaseElev+DistBase];
# ----------------------------------------
byCoordinates = Point.ByCoordinates(x=XYZ.X, y=XYZ.Y, z=code_block_4)
code_block_5 = CodeBlock { 1000; 1000; 100; }
byLengths = Cuboid.ByLengths(origin=byCoordinates, width=code_block_5.out0, length=code_block_5.out1, height=code_block_5.out2)
flatten_2 = List.Flatten(list=byLengths)
doesIntersect = Geometry.DoesIntersect(geometry=flatten_2, other=point_cloud_list_getitematindex, lacing=CrossProduct)
filterByBoolMask = List.FilterByBoolMask(list=point_cloud_list_getitematindex, mask=doesIntersect@L2)
flatten_3 = List.Flatten(list=filterByBoolMask.in@L2)
ꟿ_points_minarearectangle = Custom[ꟿ Points.MinAreaRectangle](points=flatten_3@L3, elevation=code_block_4@L2, lacing=Shortest)  # package spring nodes; Computes the minimum area rectangle in xy space for a set of points using a linear time algorithm

# group: Creation of slanted column axes
center = Polygon.Center(polygon=ꟿ_points_minarearectangle.rectangle)
flatten_4 = List.Flatten(list=center)
code_block_6 = CodeBlock(point=flatten_4) { point[0]; point[1]; }
byStartPointEndPoint = Line.ByStartPointEndPoint(startPoint=code_block_6.out1, endPoint=code_block_6.out0)
extendStart = Curve.ExtendStart(curve=byStartPointEndPoint, distance=code_block_3.Base_offset)
extendEnd = Curve.ExtendEnd(curve=extendStart, distance=code_block_3.Top_offset)

# group: WALL INSERTION DISPLACEMENT
firstItem = List.FirstItem(list=center)
list_create_2 = List.Create(item0=ꟿ_points_minarearectangle.rectangle)
flatten_5 = List.Flatten(list=list_create_2)
firstItem_2 = List.FirstItem(list=flatten_5)
curves = PolyCurve.Curves(polyCurve=firstItem_2)
midPoint = Custom[Curve.MidPoint](curve=curves)  # package Landform; Get the midpoint along the Curve
distanceTo = Geometry.DistanceTo(geometry=midPoint, other=point_cloud_list_getitematindex@L2, lacing=CrossProduct)
minimumItem = List.MinimumItem(list=distanceTo)
flatten_6 = List.Flatten(list=minimumItem)
maximumItem = List.MaximumItem(list=flatten_6)
indexOf = List.IndexOf(list=flatten_6, element=maximumItem)
getItemAtIndex = List.GetItemAtIndex(list=midPoint@L2, index=indexOf)
byTwoPoints = Vector.ByTwoPoints(start=firstItem, end=getItemAtIndex)
code_block_7 = CodeBlock(x=distance_inside_the_wall) { x/2; }
translate = Geometry.Translate(geometry=extendEnd, direction=byTwoPoints, distance=code_block_7)

# group: Base and Height dimensions
midPoint_2 = Custom[Curve.MidPoint](curve=byStartPointEndPoint)
parameterAtPoint = Curve.ParameterAtPoint(curve=byStartPointEndPoint, point=midPoint_2, lacing=Longest)
coordinateSystemAtParameter = Curve.CoordinateSystemAtParameter(curve=byStartPointEndPoint, param=parameterAtPoint, lacing=Longest)
code_block_8 = CodeBlock { 50; 1000; 1000; }
length = Curve.Length(curve=byStartPointEndPoint)
byLengths_2 = Cuboid.ByLengths(cs=coordinateSystemAtParameter, width=code_block_8.out0, length=length, height=code_block_8.out2)
ZAxis = Vector.ZAxis()
firstItem_3 = List.FirstItem(list=ꟿ_points_minarearectangle.angle@L2)
code_block_9 = CodeBlock(angulo=firstItem_3) { angulo+90; }
list_create_3 = List.Create(item0=firstItem_3, item1=code_block_9)
rotate = Geometry.Rotate(geometry=byLengths_2, origin=midPoint_2, axis=ZAxis, degrees=list_create_3)
doesIntersect_2 = Geometry.DoesIntersect(geometry=rotate@L2, other=point_cloud_list_getitematindex@L3, lacing=Longest)
filterByBoolMask_2 = List.FilterByBoolMask(list=point_cloud_list_getitematindex, mask=doesIntersect_2@L2)
flatten_7 = List.Flatten(list=filterByBoolMask_2.in@L2)
distanceTo_2 = Geometry.DistanceTo(geometry=byStartPointEndPoint, other=flatten_7)
average = Math.Average(numbers=distanceTo_2)
code_block_10 = CodeBlock(n=average) { n*2; 5; }
roundToPrecision = Custom[Math.RoundToPrecision](dbl=code_block_10.out0, precision=code_block_10.out1)  # package Clockwork for Dynamo 1.x; Rounds a number to a specified precision
firstItem_4 = List.FirstItem(list=roundToPrecision)
code_block_11 = CodeBlock(x=firstItem_4, y=distance_inside_the_wall) { x+y; }

# group: Creation of project families with names and dimensions
code_block_12 = CodeBlock(w=code_block_11, dim=roundToPrecision) { w; dim[1]; }
toString = Custom[Springs.Number.ToString](num=code_block_12.w)  # package spring nodes; Converts the input number(s) to string. You can optionally limit the number of digits.
toString_2 = Custom[Springs.Number.ToString](num=code_block_12.out1)
code_block_13 = CodeBlock(w=toString, h=toString_2) { w+" x "+h+ "mm"; "b"; "h"; }
duplicate = Custom[Springs.ElementType.Duplicate](elementType=rectangular_column, newName=code_block_13.out0)  # package spring nodes; Create duplicate element types. If the type exists, it will be appended instead.
width = Element.SetParameterByName(element=duplicate, parameterName=code_block_13.out1, value=code_block_12.w)
height = Element.SetParameterByName(element=width, parameterName=code_block_13.out2, value=code_block_12.out1)
columnByCurve = StructuralFraming.ColumnByCurve(curve=translate, level=base_level, structuralColumnType=height)

# group: Column rotation adjustment
removeNulls = Lists.Manage.RemoveNulls(Data=columnByCurve)
removeEmpty = Custom[List.RemoveEmpty](list=removeNulls.Cleaned)  # package Landform; Removes empty indices from a list.
flatten_8 = List.Flatten(list=removeEmpty)
code_block_14 = CodeBlock { "Cross-Section Rotation"; }
lastItem = List.LastItem(list=ꟿ_points_minarearectangle.angle@L3)
code_block_15 = CodeBlock(angulo=lastItem) { n = angulo * -1; }
list_create_4 = List.Create(item0=code_block_6.out0)
X = Point.X(point=list_create_4)
Y = Point.Y(point=list_create_4)
list_create_5 = List.Create(item0=code_block_6.out1)
Z = Point.Z(point=list_create_5)
byCoordinates_2 = Point.ByCoordinates(x=X, y=Y, z=Z)
byTwoPoints_2 = Vector.ByTwoPoints(start=byCoordinates_2, end=list_create_5)
YAxis = Vector.YAxis()
ZAxis_2 = Vector.ZAxis()
angleAboutAxis = Vector.AngleAboutAxis(vector=byTwoPoints_2, otherVector=YAxis, rotationAxis=ZAxis_2)
sub = code_block_15 - angleAboutAxis
flatten_9 = List.Flatten(list=sub)
setParameterByName = Element.SetParameterByName(element=flatten_8, parameterName=code_block_14, value=flatten_9)
