# Dynamo graph Structural Column_GR_1.0.0.dyn (Dynamo 2.3.0.5885)
# packages: Sastrugi 2.0.0, spring nodes 204.1.0, Landform 2016.10.13, Clockwork for Dynamo 1.x 1.0.2, LunchBox for Dynamo 2018.7.6, SteamNodes 1.2.4

# group: INPUTS
rectangular_true_round_false = BoolSelector(false)  # graph input
top_level = Levels("Level 2")  # graph input
base_level = Levels("Level 1")  # graph input
distance_inside_the_wall = DoubleSlider(0, range=0..300 step 1)  # graph input
rectangular_column = FamilyTypes("M_Concrete-Round-Column:300mm")  # graph input

# group: Point Cloud Selection
code_block = CodeBlock { 10000; }
boolean = BoolSelector(false)
pointcloud_select_points_in_view = Custom[❄_Pointcloud Select Points in View](PointSampleSize=code_block, Refresh=boolean)  # package Sastrugi; (Sastrugi_Pointcloud_Geometry) This node allows users to select a specific number of Pointcloud Points by creating a selection region in the Active View.

# group: Noise and artifact reduction
code_block_2 = CodeBlock { 100; }
ꟿ_geometry_groupbydistance = Custom[ꟿ Geometry.GroupByDistance](geometry=pointcloud_select_points_in_view.Points, margin=code_block_2)  # package spring nodes; Splits the list of geometry elements into groups if the distance between them is less than the provided margin.
flatten = List.Flatten(list=ꟿ_geometry_groupbydistance@L2)
count = List.Count(list=flatten@L2)
ꟿ_list_maxindex = Custom[ꟿ List.MaxIndex](list=count)  # package spring nodes; Gets the maximum index of a list. Good for use with floating point values
point_cloud_list_getitematindex = List.GetItemAtIndex(list=flatten, index=ꟿ_list_maxindex.idx)

# group: Profile selection
byBestFitThroughPoints = Line.ByBestFitThroughPoints(bestFitPoints=point_cloud_list_getitematindex)
endPoint = Curve.EndPoint(curve=byBestFitThroughPoints)
startPoint = Curve.StartPoint(curve=byBestFitThroughPoints)
list_create = List.Create(item0=endPoint, item1=startPoint)
XYZ = Custom[Point.XYZ](point=list_create)  # package Landform; Get the X, Y, and Z components of a Point
deconstruct = List.Deconstruct(list=XYZ.Z)
code_block_3 = CodeBlock { 150; }
code_block_4 = CodeBlock(z1=deconstruct.first, x=code_block_3, z2=deconstruct.rest) { y=z1-x; w=z2+x; }
list_create_2 = List.Create(item0=code_block_4.y, item1=code_block_4.w)
byCoordinates = Point.ByCoordinates(x=XYZ.X, y=XYZ.Y, z=list_create_2)
code_block_5 = CodeBlock { 1000; 1000; 100; }
byLengths = Cuboid.ByLengths(origin=byCoordinates, width=code_block_5.out0, length=code_block_5.out1, height=code_block_5.out2)
flatten_2 = List.Flatten(list=byLengths)
doesIntersect = Geometry.DoesIntersect(geometry=flatten_2, other=point_cloud_list_getitematindex, lacing=CrossProduct)
filterByBoolMask = List.FilterByBoolMask(list=point_cloud_list_getitematindex, mask=doesIntersect@L2)
flatten_3 = List.Flatten(list=filterByBoolMask.in@L2)
flatten_4 = List.Flatten(list=list_create_2)
ꟿ_points_minarearectangle = Custom[ꟿ Points.MinAreaRectangle](points=flatten_3@L3, elevation=flatten_4@L2, lacing=Shortest)  # package spring nodes; Computes the minimum area rectangle in xy space for a set of points using a linear time algorithm

# group: Type of column (condition)
runMe = Custom[Tool.RunMe](Boolean=rectangular_true_round_false, ThingToDo=ꟿ_points_minarearectangle.rectangle)  # package SteamNodes; Use Boolean to perform an action
center = Polygon.Center(polygon=runMe)
flatten_5 = List.Flatten(list=center)
not_ = Not(x=rectangular_true_round_false)
runMe_2 = Custom[Tool.RunMe](Boolean=not_, ThingToDo=flatten_3)
not_2 = Not(x=rectangular_true_round_false)

# group: Creation of slanted column axes
byBestFit = Sphere.ByBestFit(points=runMe_2)
centroid = Solid.Centroid(solid=byBestFit)
top_level_elevation = Level.Elevation(level=top_level)
base_level_elevation = Level.Elevation(level=base_level)

# group (continued): Type of column (condition)
list_create_3 = List.Create(item0=flatten_5, item1=centroid)
flatten_6 = List.Flatten(list=list_create_3)
removeNulls = Lists.Manage.RemoveNulls(Data=flatten_6)

# group (continued): Creation of slanted column axes
flatten_7 = List.Flatten(list=removeNulls.Cleaned)
code_block_6 = CodeBlock(point=flatten_7) { point[0]; point[1]; }
byStartPointEndPoint = Line.ByStartPointEndPoint(startPoint=code_block_6.out1, endPoint=code_block_6.out0)
XYZ_2 = Custom[Point.XYZ](point=removeNulls.Cleaned)
flatten_8 = List.Flatten(list=XYZ_2.Z)
removeNulls_2 = Lists.Manage.RemoveNulls(Data=flatten_8)
deconstruct_2 = List.Deconstruct(list=removeNulls_2.Cleaned)
code_block_7 = CodeBlock(ztop=top_level_elevation, zp=deconstruct_2.first, zbase=base_level_elevation, zp2=deconstruct_2.rest) { n=ztop-zp; n2=zbase-zp2; }
abs = Math.Abs(number=code_block_7.n)
abs_2 = Math.Abs(number=code_block_7.n2)
code_block_8 = CodeBlock(Top_offset=abs, Base_offset=abs_2) { Top_offset; Base_offset; }
extendStart = Curve.ExtendStart(curve=byStartPointEndPoint, distance=code_block_8.Base_offset)
extendEnd = Curve.ExtendEnd(curve=extendStart, distance=code_block_8.Top_offset)

# group: WALL INSERTION DISPLACEMENT
firstItem = List.FirstItem(list=removeNulls.Cleaned)
list_create_4 = List.Create(item0=ꟿ_points_minarearectangle.rectangle)
flatten_9 = List.Flatten(list=list_create_4)
firstItem_2 = List.FirstItem(list=flatten_9)
curves = PolyCurve.Curves(polyCurve=firstItem_2)
midPoint = Custom[Curve.MidPoint](curve=curves)  # package Landform; Get the midpoint along the Curve
distanceTo = Geometry.DistanceTo(geometry=midPoint, other=point_cloud_list_getitematindex@L2, lacing=CrossProduct)
minimumItem = List.MinimumItem(list=distanceTo)
flatten_10 = List.Flatten(list=minimumItem)
maximumItem = List.MaximumItem(list=flatten_10)
indexOf = List.IndexOf(list=flatten_10, element=maximumItem)
getItemAtIndex = List.GetItemAtIndex(list=midPoint@L2, index=indexOf)
byTwoPoints = Vector.ByTwoPoints(start=firstItem, end=getItemAtIndex)
code_block_9 = CodeBlock(x=distance_inside_the_wall) { x/2; }
translate = Geometry.Translate(geometry=extendEnd, direction=byTwoPoints, distance=code_block_9)

# group (continued): Type of column (condition)
runMe_3 = Custom[Tool.RunMe](Boolean=rectangular_true_round_false, ThingToDo=byStartPointEndPoint)
runMe_4 = Custom[Tool.RunMe](Boolean=not_2, ThingToDo=extendEnd)

# group: Base and Height dimensions
midPoint_2 = Custom[Curve.MidPoint](curve=runMe_3)
parameterAtPoint = Curve.ParameterAtPoint(curve=byStartPointEndPoint, point=midPoint_2, lacing=Longest)
coordinateSystemAtParameter = Curve.CoordinateSystemAtParameter(curve=byStartPointEndPoint, param=parameterAtPoint, lacing=Longest)
code_block_10 = CodeBlock { 50; 1000; 1000; }
length = Curve.Length(curve=byStartPointEndPoint)
byLengths_2 = Cuboid.ByLengths(cs=coordinateSystemAtParameter, width=code_block_10.out0, length=length, height=code_block_10.out2)
ZAxis = Vector.ZAxis()
firstItem_3 = List.FirstItem(list=ꟿ_points_minarearectangle.angle@L2)
code_block_11 = CodeBlock(angulo=firstItem_3) { angulo+90; }
list_create_5 = List.Create(item0=firstItem_3, item1=code_block_11)
rotate = Geometry.Rotate(geometry=byLengths_2, origin=midPoint_2, axis=ZAxis, degrees=list_create_5)
doesIntersect_2 = Geometry.DoesIntersect(geometry=rotate@L2, other=point_cloud_list_getitematindex@L3, lacing=Longest)
filterByBoolMask_2 = List.FilterByBoolMask(list=point_cloud_list_getitematindex, mask=doesIntersect_2@L2)
flatten_11 = List.Flatten(list=filterByBoolMask_2.in@L2)
distanceTo_2 = Geometry.DistanceTo(geometry=byStartPointEndPoint, other=flatten_11)
average = Math.Average(numbers=distanceTo_2)
code_block_12 = CodeBlock(n=average) { n*2; 5; }
roundToPrecision = Custom[Math.RoundToPrecision](dbl=code_block_12.out0, precision=code_block_12.out1)  # package Clockwork for Dynamo 1.x; Rounds a number to a specified precision
firstItem_4 = List.FirstItem(list=roundToPrecision)
code_block_13 = CodeBlock(x=firstItem_4, y=distance_inside_the_wall) { x+y; }

# group: Creation of project families with names and dimensions
code_block_14 = CodeBlock(w=code_block_13, dim=roundToPrecision) { w; dim[1]; }
toString = Custom[Springs.Number.ToString](num=code_block_14.w)  # package spring nodes; Converts the input number(s) to string. You can optionally limit the number of digits.
toString_2 = Custom[Springs.Number.ToString](num=code_block_14.out1)
code_block_15 = CodeBlock(w=toString, h=toString_2) { w+" x "+h+ "mm"; "b"; "d"; }
duplicate = Custom[Springs.ElementType.Duplicate](elementType=rectangular_column, newName=code_block_15.out0)  # package spring nodes; Create duplicate element types. If the type exists, it will be appended instead.
width = Element.SetParameterByName(element=duplicate, parameterName=code_block_15.out1, value=code_block_14.w)
height = Element.SetParameterByName(element=width, parameterName=code_block_15.out2, value=code_block_14.out1)
columnByCurve = StructuralFraming.ColumnByCurve(curve=translate, level=base_level, structuralColumnType=height)

# group: Column rotation adjustment
removeNulls_3 = Lists.Manage.RemoveNulls(Data=columnByCurve)
removeEmpty = Custom[List.RemoveEmpty](list=removeNulls_3.Cleaned)  # package Landform; Removes empty indices from a list.
flatten_12 = List.Flatten(list=removeEmpty)
code_block_16 = CodeBlock { "Cross-Section Rotation"; }
lastItem = List.LastItem(list=ꟿ_points_minarearectangle.angle@L3)
code_block_17 = CodeBlock(angulo=lastItem) { n = angulo * -1; }
list_create_6 = List.Create(item0=code_block_6.out0)
X = Point.X(point=list_create_6)
Y = Point.Y(point=list_create_6)
list_create_7 = List.Create(item0=code_block_6.out1)
Z = Point.Z(point=list_create_7)
byCoordinates_2 = Point.ByCoordinates(x=X, y=Y, z=Z)
byTwoPoints_2 = Vector.ByTwoPoints(start=byCoordinates_2, end=list_create_7)
YAxis = Vector.YAxis()
ZAxis_2 = Vector.ZAxis()
angleAboutAxis = Vector.AngleAboutAxis(vector=byTwoPoints_2, otherVector=YAxis, rotationAxis=ZAxis_2)
sub = code_block_17 - angleAboutAxis
flatten_13 = List.Flatten(list=sub)
setParameterByName = Element.SetParameterByName(element=flatten_12, parameterName=code_block_16, value=flatten_13)

# group: ROUND - Creation of project families with names and dimensions
distanceTo_3 = Geometry.DistanceTo(geometry=runMe_4, other=flatten_3)
minimumItem_2 = List.MinimumItem(list=distanceTo_3)
flatten_14 = List.Flatten(list=minimumItem_2)
code_block_18 = CodeBlock(r=flatten_14) { b=r*2; 5; }
roundUpToPrecision = Custom[Math.RoundUpToPrecision](dbl=code_block_18.b, precision=code_block_18.out1)  # package Clockwork for Dynamo 1.x; Rounds a number *up* to a specified precision
toString_3 = Custom[Springs.Number.ToString](num=roundUpToPrecision)
code_block_19 = CodeBlock(h=toString_3) { h+ "mm"; "b"; }
duplicate_2 = Custom[Springs.ElementType.Duplicate](elementType=rectangular_column, newName=code_block_19.out0)
width_2 = Element.SetParameterByName(element=duplicate_2, parameterName=code_block_19.out1, value=roundUpToPrecision)

# group: Round Column
columnByCurve_2 = StructuralFraming.ColumnByCurve(curve=extendEnd, level=base_level, structuralColumnType=width_2)
