# Dynamo graph Subregion_0.0.1.dyn "Subregion_Grazi_0.0.1" (Dynamo 2.3.0.5885)

# group: NOTES BEFORE RUNNING
# note: Before running the script, in Dynamo you must set the geometry scaling to Large:
# Settings > Geometry Scaling > Large
# You need to select in Revit the CAD, the toposurface, and all the boundary lines.
# Save your work before clicking "RUN", as the file may crash. The operation may take a while, on my computer it took 5 minutes to complete.

# group: INPUTS
cad_selection = DSModelElementSelection()  # 1 picked in the model; graph input
boundary_selection = DSModelElementsSelection()  # 4 picked in the model
topo_selection = DSModelElementSelection()  # 1 picked in the model; graph input

# group: POLYLINES SELECTION
geometry = Element.Geometry(element=cad_selection)
explode = Geometry.Explode(geometry=geometry)

# group: BOUNDARY CREATION
geometry_2 = Element.Geometry(element=boundary_selection)
flatten = List.Flatten(list=geometry_2)
byJoinedCurves = PolyCurve.ByJoinedCurves(curves=flatten)
ZAxis = Vector.ZAxis()
reverse = Vector.Reverse(vector=ZAxis)
list_create = List.Create(item0=ZAxis, item1=reverse)
code_block = CodeBlock { 1000; }
translate = Geometry.Translate(geometry=byJoinedCurves, direction=list_create, distance=code_block)
byLoft = Solid.ByLoft(crossSections=translate)

# group: REMOVAL OF POLYLINES THAT ARE OUTSIDE THE BOUNDARY
doesIntersect = Geometry.DoesIntersect(geometry=explode, other=byLoft)
code_block_2 = CodeBlock { true; }
contains = List.Contains(item=code_block_2)  # unwired: list
map = List.Map(list=doesIntersect, f_x=contains)
filterByBoolMask = List.FilterByBoolMask(list=explode, mask=map)
flatten_2 = List.Flatten(list=filterByBoolMask.in@L2)

# group: OUTPUT: SUBREGIONS
python_script = Python(IN[0]=flatten_2, IN[1]=topo_selection)
# ---------- python_script.python (52 lines) ----------
import clr

clr.AddReference('RevitAPI')
from Autodesk.Revit.DB import *
from Autodesk.Revit.DB.Architecture import *
import System.Collections.Generic
from System.Collections.Generic import List

clr.AddReference('RevitNodes')
import Revit
clr.ImportExtensions(Revit.GeometryConversion)

clr.AddReference('RevitServices')
from RevitServices.Transactions import TransactionManager
from RevitServices.Persistence import DocumentManager

doc = DocumentManager.Instance.CurrentDBDocument

# Get input variables
subregions = IN[0]
host = UnwrapElement(IN[1])

# Init variables
curveLoops = []
createdSubRegions = []
error = []

TransactionManager.Instance.EnsureInTransaction(doc)

# Get groups of curves (exploded polycurves!) and creates per group a SubRegion
for i in subregions:
	# Init CurveLoop for every curve group
	x = CurveLoop()
	
	# Iterate the seperate curves -> convert type to Revit Type -> add to CurveLoop
	for j in i:
		x.Append(j.ToRevitType())
	curveLoops.append(x)
	
	# Add layer to list
	y = [x]
	yI = List[CurveLoop](y)
	
	if SiteSubRegion.IsValidBoundary(yI):
		# Create SubRegion out of the CurveLoop group and add its to 'createdSubregions'
		newSubRegion = SiteSubRegion.Create(doc, yI, host.Id)
		createdSubRegions.append(newSubRegion)
	
TransactionManager.Instance.TransactionTaskDone()

# Output
OUT = createdSubRegions
# ----------------------------------------
