# Dynamo graph Topography_GR_0.2.1.dyn (Dynamo 2.3.0.5885)
# packages: Sastrugi 2.0.0, Data-Shapes 2022.2.96, Clockwork for Dynamo 1.x 1.0.2

# group: User Inputs
code_block = CodeBlock { "Amount of selected points (point cloud)"; 1000; 200000; 100000; 100; }
slider = Custom[Slider](InputName=code_block.out0, Minimum=code_block.out1, Maximum=code_block.out2, Default_Value=code_block.out3, Step=code_block.out4)  # package Data-Shapes; Creates slider input for UI.MultipleInputForm ++ . Set the step to decimal value if you want a double slider, or to a integer value if you want an integer slider.
code_block_2 = CodeBlock { "Point reduction for toposurface (%)"; 0; 100; 90; 1; }
slider_2 = Custom[Slider](InputName=code_block_2.out0, Minimum=code_block_2.out1, Maximum=code_block_2.out2, Default_Value=code_block_2.out3, Step=code_block_2.out4)
code_block_3 = CodeBlock()
# ---------- code_block_3.designscript (15 lines) ----------
"Instructions";
"1. The Revit project units must be set in millimeters (mm);

2. A filtered point cloud with the ground points must be used;

3. To increase script performance and facilitate computer processing, the amount of points must be previously reduced in other software;

4. Suggested values for inputs:
                       Amount of points = 100000
                       Point reduction = 90%;

5. Please cite our paper if you use the script in your work.

contact: gustavomrocha@gmail.com - gustavorocha@fa.ulisboa.pt
";
# ----------------------------------------
textnote_data = Custom[TextNote Data](Title=code_block_3.out0, TextNote=code_block_3.out1)  # package Data-Shapes; Create Data for TextNote input in UI.MultipleInputForm ++ . Check out www.data-shapes.net for more informations
list_create = List.Create(item0=slider, item1=slider_2, item2=textnote_data)

# group: User Interface
code_block_4 = CodeBlock { "Toposurface Creation"; "Run Script"; "https://github.com/gustavomrocha85/dynamo"; "Cancel"; 500; 230; }
boolean = BoolSelector(true)
multipleinputform = Custom[MultipleInputForm ++](Description_optional=code_block_4.out0, ButtonText_optional=code_block_4.out1, Inputs=list_create, Toggle=boolean, LinkToHelp_optional=code_block_4.out2, CancelButtonText_optional=code_block_4.out3, Width_optional=code_block_4.out4, LabelWidth_optional=code_block_4.out5)  # package Data-Shapes; Create a form with multiple inputs. see www.data-shapes.net for tutorials and infos!
code_block_5 = CodeBlock(input=multipleinputform.User_Inputs) { input[0]; input[1]; }

# group: Point Cloud Selection
boolean_2 = BoolSelector(true)
pointcloud_select_points_in_view = Custom[❄_Pointcloud Select Points in View](PointSampleSize=code_block_5.out0, Refresh=boolean_2)  # package Sastrugi; (Sastrugi_Pointcloud_Geometry) This node allows users to select a specific number of Pointcloud Points by creating a selection region in the Active View.
passthrough = Custom[Passthrough](passThrough=pointcloud_select_points_in_view.Points, waitFor=multipleinputform.User_Inputs)  # package Clockwork for Dynamo 1.x; Forces a sequential order of execution. The node wired into the output of the Passthrough node will be executed *after* the node wired into the waitFor input (e.g. important for some Revit operations). The value of the passThrough input will be passed on to the node wired into the output port of the Passthrough node.

# group: Point Cloud reduction
count = List.Count(list=passthrough@L2)
code_block_6 = CodeBlock(y=code_block_5.out1) { x=y*0.01; }
code_block_7 = CodeBlock(x=count, y=code_block_6) { z=x-y*x; x/z; }
takeEveryNthItem = List.TakeEveryNthItem(list=passthrough@L2, n=code_block_7.out1)

# group: Toposurface
byPoints = Topography.ByPoints(points=takeEveryNthItem)  # graph output
