# Dynamo graph Topography_GR_1.0.0.dyn (Dynamo 2.3.0.5885)
# packages: Sastrugi 2.0.0

# group: Point Cloud Selection
number_of_points = DoubleSlider(100000, range=1000..200000 step 100)  # graph input
boolean = BoolSelector(true)
pointcloud_select_points_in_view = Custom[❄_Pointcloud Select Points in View](PointSampleSize=number_of_points, Refresh=boolean)  # package Sastrugi; (Sastrugi_Pointcloud_Geometry) This node allows users to select a specific number of Pointcloud Points by creating a selection region in the Active View.

# group: Point Cloud reduction
count = List.Count(list=pointcloud_select_points_in_view.Points@L2)
point_cloud_reduction = DoubleSlider(90, range=0..100 step 1)  # graph input
code_block = CodeBlock(y=point_cloud_reduction) { x=y*0.01; }
code_block_2 = CodeBlock(x=count, y=code_block) { z=x-y*x; x/z; }
takeEveryNthItem = List.TakeEveryNthItem(list=pointcloud_select_points_in_view.Points@L2, n=code_block_2.out1)

# group: Toposurface
byPoints = Topography.ByPoints(points=takeEveryNthItem)  # graph output
