# Dynamo graph Vault_Mass-CV_Ap03_1.0.0.dyn "Ceiling_Mass_GR_0.3.6" (Dynamo 2.3.0.5885)
# packages: MeshToolkit 3.0.0, Landform 2016.10.13

# group: Mesh import and reduction
mesh = Filename("..\Teto\Pena\Cupula\Mesh Subsampled Final decimated.obj")  # graph input
importFile = Autodesk.Dynamo.MeshToolkit.Mesh.ImportFile(fileName=mesh)
triangleCount = Autodesk.Dynamo.MeshToolkit.Mesh.TriangleCount(mesh=importFile)
triangle_reduction = DoubleSlider(50, range=0..100 step 1)  # graph input
code_block = CodeBlock(y=triangle_reduction) { x=y*0.01; }
code_block_2 = CodeBlock(x=triangleCount, y=code_block) { z=x-y*x; }
reduce = Autodesk.Dynamo.MeshToolkit.Mesh.Reduce(mesh=importFile, triangleCount=code_block_2)

# group: Get base profile
vertices = Autodesk.Dynamo.MeshToolkit.Mesh.Vertices(mesh=reduce)
byGeometry = BoundingBox.ByGeometry(geom=vertices)
toPolySurface = BoundingBox.ToPolySurface(boundingBox=byGeometry)
doesIntersect = Geometry.DoesIntersect(geometry=toPolySurface, other=vertices, lacing=Longest)
filterByBoolMask = List.FilterByBoolMask(list=vertices, mask=doesIntersect)
flatten = List.Flatten(list=filterByBoolMask.in)
surfaces = PolySurface.Surfaces(polySurface=toPolySurface)
flatten_2 = List.Flatten(list=surfaces)
normalAtParameter = Surface.NormalAtParameter(surface=flatten_2)
isParallel = Vector.IsParallel(vector=normalAtParameter, other=normalAtParameter, lacing=CrossProduct)
firstItem = List.FirstItem(list=isParallel)
filterByBoolMask_2 = List.FilterByBoolMask(list=flatten_2@L2, mask=firstItem)
flatten_3 = List.Flatten(list=filterByBoolMask_2.out)
doesIntersect_2 = Geometry.DoesIntersect(geometry=flatten@L2, other=flatten_3, lacing=Longest)
code_block_3 = CodeBlock { true; }
indexOf = List.IndexOf(list=doesIntersect_2@L2, element=code_block_3)
getItemAtIndex = List.GetItemAtIndex(list=flatten, index=indexOf)
XYZ = Custom[Point.XYZ](point=getItemAtIndex)  # package Landform; Get the X, Y, and Z components of a Point
Z = Point.Z(point=getItemAtIndex)
minimumItem = List.MinimumItem(list=Z)
byCoordinates = Point.ByCoordinates(x=XYZ.X, y=XYZ.Y, z=minimumItem)
boolean = BoolSelector(true)
byPoints = PolyCurve.ByPoints(points=byCoordinates, connectLastToFirst=boolean)

# group: Get Z-axis profiles
firstItem_2 = List.FirstItem(list=byCoordinates)
byOriginNormal = Plane.ByOriginNormal(origin=firstItem_2)
Z_2 = Point.Z(point=firstItem_2)
Z_3 = Point.Z(point=flatten)
maximumItem = List.MaximumItem(list=Z_3)
code_block_4 = CodeBlock(x=maximumItem, y=Z_2) { x-y; }
number_of_vertical_divisions = IntegerSlider(4, range=0..20 step 1)  # graph input
code_block_5 = CodeBlock(x=code_block_4, y=number_of_vertical_divisions) { x/y; }
range = Range(start=Z_2, end=maximumItem, step=code_block_5)
code_block_6 = CodeBlock { 0; }
removeItemAtIndex = List.RemoveItemAtIndex(list=range, indices=code_block_6)
code_block_7 = CodeBlock(x=removeItemAtIndex, y=Z_2) { x-y; }
offset = Plane.Offset(plane=byOriginNormal, dist=code_block_7)
XYZ_2 = Custom[Point.XYZ](point=firstItem_2)
code_block_8 = CodeBlock(x=maximumItem) { x-0.15; }
byCoordinates_2 = Point.ByCoordinates(x=XYZ_2.X, y=XYZ_2.Y, z=code_block_8)
byOriginNormal_2 = Plane.ByOriginNormal(origin=byCoordinates_2)
list_create = List.Create(item0=offset, item1=byOriginNormal_2)
flatten_4 = List.Flatten(list=list_create)
intersect = Autodesk.Dynamo.MeshToolkit.Mesh.Intersect(mesh=reduce, intersectionPlane=flatten_4, lacing=Longest)

# group: Profiles simplification
list_create_2 = List.Create(item0=byPoints, item1=intersect)
flatten_5 = List.Flatten(list=list_create_2)
curves = PolyCurve.Curves(polyCurve=flatten_5)
count = List.Count(list=curves@L2)
code_block_9 = CodeBlock(x=count) { x>=4; }
filterByBoolMask_3 = List.FilterByBoolMask(list=curves, mask=code_block_9)
endPoint = Curve.EndPoint(curve=filterByBoolMask_3.in)
startPoint = Curve.StartPoint(curve=filterByBoolMask_3.in)
list_create_3 = List.Create(item0=endPoint, item1=startPoint)
transpose = List.Transpose(lists=list_create_3)
flatten_6 = List.Flatten(list=transpose@L3)
pruneDuplicates = Point.PruneDuplicates(points=flatten_6)
distanceTo = Geometry.DistanceTo(geometry=pruneDuplicates, other=byCoordinates, lacing=CrossProduct)
minimumItem_2 = List.MinimumItem(list=distanceTo)
indexOf_2 = List.IndexOf(list=distanceTo@L2, element=minimumItem_2@@L1)
getItemAtIndex_2 = List.GetItemAtIndex(list=pruneDuplicates@L2, index=indexOf_2@L2)
boolean_2 = BoolSelector(true)
byPoints_2 = PolyCurve.ByPoints(points=getItemAtIndex_2, connectLastToFirst=boolean_2)

# group: Get top line
Z_4 = Point.Z(point=vertices)
maximumItem_2 = List.MaximumItem(list=Z_4)
code_block_10 = CodeBlock(x=maximumItem_2) { x-0.012; }
code_block_11 = CodeBlock(x=Z_4, y=code_block_10) { x>y; }
filterByBoolMask_4 = List.FilterByBoolMask(list=vertices, mask=code_block_11)
list_create_4 = List.Create(item0=filterByBoolMask_4.in)
byBestFitThroughPoints = Line.ByBestFitThroughPoints(bestFitPoints=list_create_4)
code_block_12 = CodeBlock { [0.001,-0.001]; }
offset_2 = Curve.Offset(curve=byBestFitThroughPoints, distance=code_block_12, lacing=CrossProduct)
flatten_7 = List.Flatten(list=offset_2)
code_block_13 = CodeBlock(c=flatten_7) { c[0]; c[1]; }
endPoint_2 = Curve.EndPoint(curve=code_block_13.out0)
endPoint_3 = Curve.EndPoint(curve=code_block_13.out1)
startPoint_2 = Curve.StartPoint(curve=code_block_13.out1)
startPoint_3 = Curve.StartPoint(curve=code_block_13.out0)
list_create_5 = List.Create(item0=endPoint_2, item1=endPoint_3, item2=startPoint_2, item3=startPoint_3)
boolean_3 = BoolSelector(true)
byPoints_3 = PolyCurve.ByPoints(points=list_create_5, connectLastToFirst=boolean_3)

# group: Creation and export of solid
list_create_6 = List.Create(item0=byPoints_2, item1=byPoints_3)
flatten_8 = List.Flatten(list=list_create_6)
byLoft = Solid.ByLoft(crossSections=flatten_8)
byGeometry_2 = ImportInstance.ByGeometry(geometry=byLoft)  # graph output
