# Dynamo graph Vault_Mesh-CV_Ap01_1.0.0.dyn "Ceiling_Mesh_GR_0.1.4" (Dynamo 2.3.0.5885)
# packages: MeshToolkit 3.0.0, spring nodes 204.1.0, Genius Loci 2021.9.7

# group: Mesh Import
mesh = Filename("..\Teto\Pena\Cupula\Mesh_georef_FINAL.obj")  # graph input
importFile = Autodesk.Dynamo.MeshToolkit.Mesh.ImportFile(fileName=mesh)

# group: Mesh Translation
get_project_locations = Custom[Get Project Locations]()  # package Genius Loci; Works only in Revit 2018 and later. Retrieves the project positions of the given document in the Survey Coordinate System. (Coordinates of Internal origin, project base point and survey point)
byTwoPoints = Vector.ByTwoPoints(start=get_project_locations.Internal_Origin, end=get_project_locations.Project_Survey_Point)
translate = Autodesk.Dynamo.MeshToolkit.Mesh.Translate(mesh=importFile, vector=byTwoPoints)

# group: Mesh reduction
triangleCount = Autodesk.Dynamo.MeshToolkit.Mesh.TriangleCount(mesh=translate)
triangle_reduction = DoubleSlider(70, range=0..100 step 1)  # graph input
code_block = CodeBlock(y=triangle_reduction) { x=y*0.01; }
code_block_2 = CodeBlock(x=triangleCount, y=code_block) { z=x-y*x; }
reduce = Autodesk.Dynamo.MeshToolkit.Mesh.Reduce(mesh=translate, triangleCount=code_block_2)

# group: Model to Revit
ꟿ_tkmesh_tomesh = Custom[ꟿ TkMesh.ToMesh](tkMesh=reduce)  # package spring nodes; Attempts to convert a toolkit mesh to a Dynamo mesh. You obviously need to have the appropriate version of the mesh toolkit package downloaded first.
categories = Categories("OST_Ceilings")  # graph input
material = StringInput("Ceiling Vault")  # graph input
byName = Material.ByName(name=material)
family_name = StringInput("Pena - Ceiling 2")  # graph input
byMesh = DirectShape.ByMesh(mesh=ꟿ_tkmesh_tomesh, category=categories, material=byName, name=family_name)
