# Dynamo graph Walls_GR_0.1.3.dyn (Dynamo 2.3.0.5885)
# packages: Sastrugi 2.0.0, Landform 2016.10.13, spring nodes 204.1.0, Clockwork for Dynamo 1.x 1.0.2, Genius Loci 2021.9.7

# group: POINT CLOUD SELECTION
code_block = CodeBlock { 20000; }
boolean = BoolSelector(false)
pointcloud_select_points_in_view = Custom[❄_Pointcloud Select Points in View](PointSampleSize=code_block, Refresh=boolean)  # package Sastrugi; (Sastrugi_Pointcloud_Geometry) This node allows users to select a specific number of Pointcloud Points by creating a selection region in the Active View.

# group: NOISER AND ARTIFACT REDUCTION
code_block_2 = CodeBlock { 100; }
ꟿ_geometry_groupbydistance = Custom[ꟿ Geometry.GroupByDistance](geometry=pointcloud_select_points_in_view.Points, margin=code_block_2)  # package spring nodes; Splits the list of geometry elements into groups if the distance between them is less than the provided margin.
flatten = List.Flatten(list=ꟿ_geometry_groupbydistance@L2)
count = List.Count(list=flatten@L2)
ꟿ_list_maxindex = Custom[ꟿ List.MaxIndex](list=count)  # package spring nodes; Gets the maximum index of a list. Good for use with floating point values
point_cloud_list_getitematindex = List.GetItemAtIndex(list=flatten, index=ꟿ_list_maxindex.idx)

# group: PROFILE POINTS SELECTION
byBestFitThroughPoints = Line.ByBestFitThroughPoints(bestFitPoints=point_cloud_list_getitematindex)
code_block_3 = CodeBlock { 100; }
code_block_4 = CodeBlock(a=code_block_3) { [a,-a]; [0,1]; 1; }
pointAtChordLength = Curve.PointAtChordLength(curve=byBestFitThroughPoints, chordLength=code_block_4.out0@L2, parameterLocation=code_block_4.out1@L2, lacing=Longest)
parameterAtPoint = Curve.ParameterAtPoint(curve=byBestFitThroughPoints, point=pointAtChordLength, lacing=Longest)
coordinateSystemAtParameter = Curve.CoordinateSystemAtParameter(curve=byBestFitThroughPoints, param=parameterAtPoint, lacing=Longest)
code_block_5 = CodeBlock { 1000; 500; 1000; }
byLengths = Cuboid.ByLengths(cs=coordinateSystemAtParameter, width=code_block_5.out0, length=code_block_5.out1, height=code_block_5.out2)
flatten_2 = List.Flatten(list=byLengths)
doesIntersect = Geometry.DoesIntersect(geometry=flatten_2, other=point_cloud_list_getitematindex, lacing=CrossProduct)
filterByBoolMask = List.FilterByBoolMask(list=point_cloud_list_getitematindex, mask=doesIntersect@L2)
list_create = List.Create(item0=filterByBoolMask.in)
flatten_3 = List.Flatten(list=list_create@L2)

# group: WALL AXIS DETECTION
byGeometry = BoundingBox.ByGeometry(geom=flatten_3)
toCuboid = BoundingBox.ToCuboid(boundingBox=byGeometry)
centroid = Solid.Centroid(solid=toCuboid)
code_block_6 = CodeBlock(point=centroid) { point[0]; point[1]; }
XYZ = Custom[Point.XYZ](point=code_block_6.out0)  # package Landform; Get the X, Y, and Z components of a Point
Z = Point.Z(point=code_block_6.out1)
byCoordinates = Point.ByCoordinates(x=XYZ.X, y=XYZ.Y, z=Z)
byStartPointEndPoint = Line.ByStartPointEndPoint(startPoint=byCoordinates, endPoint=code_block_6.out1)
extendEnd = Curve.ExtendEnd(curve=byStartPointEndPoint, distance=code_block_3)
extendStart = Curve.ExtendStart(curve=extendEnd, distance=code_block_3)

# group: INPUTS
base_constraint = Levels("Level 1")  # graph input
top_constraint = Levels("Level 2")  # graph input
wall_types = WallTypes("Interior - Blockwork 100")  # graph input

# group: WALL THICKNESS DETECTION
midPoint = Custom[Curve.MidPoint](curve=byStartPointEndPoint)  # package Landform; Get the midpoint along the Curve
code_block_7 = CodeBlock { 1000; 50; }
length = Curve.Length(curve=byStartPointEndPoint)
byLengths_2 = Cuboid.ByLengths(origin=midPoint, width=code_block_7.out0, length=length, height=code_block_7.out1)
flatten_4 = List.Flatten(list=byLengths_2)
doesIntersect_2 = Geometry.DoesIntersect(geometry=flatten_4, other=point_cloud_list_getitematindex, lacing=CrossProduct)
filterByBoolMask_2 = List.FilterByBoolMask(list=point_cloud_list_getitematindex, mask=doesIntersect_2@L2)
list_create_2 = List.Create(item0=filterByBoolMask_2.in)
flatten_5 = List.Flatten(list=list_create_2@L2)
distanceTo = Geometry.DistanceTo(geometry=byStartPointEndPoint, other=flatten_5)
average = Math.Average(numbers=distanceTo)
code_block_8 = CodeBlock(x=average) { x*2; }
code_block_9 = CodeBlock { 5; }
roundToPrecision = Custom[Math.RoundToPrecision](dbl=code_block_8, precision=code_block_9)  # package Clockwork for Dynamo 1.x; Rounds a number to a specified precision

# group: FAMILY CREATION WITH CORRECT NAME AND DIMENSIONS
toString = Custom[Springs.Number.ToString](num=roundToPrecision)  # package spring nodes; Converts the input number(s) to string. You can optionally limit the number of digits.
code_block_10 = CodeBlock(w=toString) { "Wall - "+w+"mm"; }
duplicate = Custom[FamilyType.Duplicate](elementType=wall_types, name=code_block_10)  # package Clockwork for Dynamo 1.x; Duplicates a family type
compoundStructureLayers = Custom[FamilyType.CompoundStructureLayers](elementType=wall_types)  # package Clockwork for Dynamo 1.x; Retrieves the compound layers of any layered family type (wall types, roof types, floor types etc.)
enumerate_layerfunction = Custom[Enumerate LayerFunction]()  # package Genius Loci; Enumerate the functions of the layers of the Compound System Family.
code_block_11 = CodeBlock { 1; }
getItemAtIndex = List.GetItemAtIndex(list=enumerate_layerfunction, index=code_block_11)
indexOf = List.IndexOf(list=compoundStructureLayers.functions, element=getItemAtIndex)
sum = Math.Sum(values=compoundStructureLayers.widths)
sub = sum - roundToPrecision
abs = Math.Abs(number=sub)
getItemAtIndex_2 = List.GetItemAtIndex(list=compoundStructureLayers.widths, index=indexOf)
add = abs + getItemAtIndex_2
setCompoundLayerWidth = Custom[FamilyType.SetCompoundLayerWidth](familyType=duplicate, layerIndex=indexOf, width=add)  # package Clockwork for Dynamo 1.x; Sets the width of a specified compound layer of a given family type (only applies to family types that have a compound structure, e.g. walls, floors etc.).
byCurveAndLevels = Wall.ByCurveAndLevels(c=extendStart, startLevel=base_constraint, endLevel=top_constraint, wallType=setCompoundLayerWidth.familyType)
