# Dynamo graph Walls_GR_1.0.0.dyn (Dynamo 2.3.0.5885)
# packages: Sastrugi 2.0.0, spring nodes 204.1.0, Landform 2016.10.13, Clockwork for Dynamo 1.x 1.0.2, Genius Loci 2021.9.7

# group: INPUTS
number_of_points_10000_or_20000 = DoubleSlider(20000, range=0..40000 step 1000)  # graph input
offset_from_endpoints_standard = DoubleSlider(150, range=0..1000 step 100)  # "Offset from endpoints (standard=500)"; graph input
base_constraint = Levels("Level 2")  # graph input
top_constraint = Levels("Level 3")  # graph input
wall_types = WallTypes("Generic - 200mm")  # graph input

# group: POINT CLOUD SELECTION
boolean = BoolSelector(false)
pointcloud_select_points_in_view = Custom[❄_Pointcloud Select Points in View](PointSampleSize=number_of_points_10000_or_20000, Refresh=boolean)  # package Sastrugi; (Sastrugi_Pointcloud_Geometry) This node allows users to select a specific number of Pointcloud Points by creating a selection region in the Active View.

# group: NOISE AND ARTIFACT REDUCTION
code_block = CodeBlock { 150; }
ꟿ_geometry_groupbydistance = Custom[ꟿ Geometry.GroupByDistance](geometry=pointcloud_select_points_in_view.Points, margin=code_block)  # package spring nodes; Splits the list of geometry elements into groups if the distance between them is less than the provided margin.
flatten = List.Flatten(list=ꟿ_geometry_groupbydistance@L2)
count = List.Count(list=flatten@L2)
code_block_2 = CodeBlock(x=count) { x>50; }
filterByBoolMask = List.FilterByBoolMask(list=count, mask=code_block_2)
indexOf = List.IndexOf(list=count, element=filterByBoolMask.in)

getItemAtIndex = List.GetItemAtIndex(list=flatten, index=indexOf)

# group (continued): NOISE AND ARTIFACT REDUCTION
flatten_2 = List.Flatten(list=getItemAtIndex)

# group: PROFILE POINTS SELECTION
byBestFitThroughPoints = Line.ByBestFitThroughPoints(bestFitPoints=flatten_2)
code_block_3 = CodeBlock(a=offset_from_endpoints_standard) { [a,-a]; [0,1]; 1; }
pointAtChordLength = Curve.PointAtChordLength(curve=byBestFitThroughPoints, chordLength=code_block_3.out0@L2, parameterLocation=code_block_3.out1@L2, lacing=Longest)
parameterAtPoint = Curve.ParameterAtPoint(curve=byBestFitThroughPoints, point=pointAtChordLength, lacing=Longest)
coordinateSystemAtParameter = Curve.CoordinateSystemAtParameter(curve=byBestFitThroughPoints, param=parameterAtPoint, lacing=Longest)
code_block_4 = CodeBlock { 1000; 500; 1000; }
byLengths = Cuboid.ByLengths(cs=coordinateSystemAtParameter, width=code_block_4.out0, length=code_block_4.out1, height=code_block_4.out2)
flatten_3 = List.Flatten(list=byLengths)
doesIntersect = Geometry.DoesIntersect(geometry=flatten_3, other=flatten_2, lacing=CrossProduct)
filterByBoolMask_2 = List.FilterByBoolMask(list=flatten_2, mask=doesIntersect@L2)
list_create = List.Create(item0=filterByBoolMask_2.in)
flatten_4 = List.Flatten(list=list_create@L2)

# group: WALL AXIS DETECTION
byGeometry = BoundingBox.ByGeometry(geom=flatten_4)

toCuboid = BoundingBox.ToCuboid(boundingBox=byGeometry)

# group (continued): WALL AXIS DETECTION
centroid = Solid.Centroid(solid=toCuboid)
flatten_5 = List.Flatten(list=centroid)
code_block_5 = CodeBlock(point=flatten_5) { point[0]; point[1]; }
XYZ = Custom[Point.XYZ](point=code_block_5.out0)  # package Landform; Get the X, Y, and Z components of a Point
Z = Point.Z(point=code_block_5.out1)
byCoordinates = Point.ByCoordinates(x=XYZ.X, y=XYZ.Y, z=Z)
byStartPointEndPoint = Line.ByStartPointEndPoint(startPoint=byCoordinates, endPoint=code_block_5.out1)
extendEnd = Curve.ExtendEnd(curve=byStartPointEndPoint, distance=offset_from_endpoints_standard)
extendStart = Curve.ExtendStart(curve=extendEnd, distance=offset_from_endpoints_standard)

# group: WALL THICKNESS DETECTION
midPoint = Custom[Curve.MidPoint](curve=byStartPointEndPoint)  # package Landform; Get the midpoint along the Curve
code_block_6 = CodeBlock { 1000; 50; }
length = Curve.Length(curve=byStartPointEndPoint)
byLengths_2 = Cuboid.ByLengths(origin=midPoint, width=code_block_6.out0, length=length, height=code_block_6.out1)
flatten_6 = List.Flatten(list=byLengths_2)
doesIntersect_2 = Geometry.DoesIntersect(geometry=flatten_6, other=flatten_2, lacing=CrossProduct)
filterByBoolMask_3 = List.FilterByBoolMask(list=flatten_2, mask=doesIntersect_2@L2)
list_create_2 = List.Create(item0=filterByBoolMask_3.in)
flatten_7 = List.Flatten(list=list_create_2@L2)
distanceTo = Geometry.DistanceTo(geometry=extendStart, other=flatten_7)
average = Math.Average(numbers=distanceTo)
code_block_7 = CodeBlock(x=average) { x*2; }
code_block_8 = CodeBlock { 5; }
roundToPrecision = Custom[Math.RoundToPrecision](dbl=code_block_7, precision=code_block_8)  # package Clockwork for Dynamo 1.x; Rounds a number to a specified precision

# group: FAMILY CREATION WITH CORRECT NAME AND DIMENSIONS
toString = Custom[Springs.Number.ToString](num=roundToPrecision)  # package spring nodes; Converts the input number(s) to string. You can optionally limit the number of digits.
code_block_9 = CodeBlock(w=toString) { "Wall - "+w+"mm"; }
duplicate = Custom[FamilyType.Duplicate](elementType=wall_types, name=code_block_9)  # package Clockwork for Dynamo 1.x; Duplicates a family type
compoundStructureLayers = Custom[FamilyType.CompoundStructureLayers](elementType=wall_types)  # package Clockwork for Dynamo 1.x; Retrieves the compound layers of any layered family type (wall types, roof types, floor types etc.)
enumerate_layerfunction = Custom[Enumerate LayerFunction]()  # package Genius Loci; Enumerate the functions of the layers of the Compound System Family.
code_block_10 = CodeBlock { 1; }
getItemAtIndex_2 = List.GetItemAtIndex(list=enumerate_layerfunction, index=code_block_10)
indexOf_2 = List.IndexOf(list=compoundStructureLayers.functions, element=getItemAtIndex_2)
setCompoundLayerWidth = Custom[FamilyType.SetCompoundLayerWidth](familyType=duplicate, layerIndex=indexOf_2, width=roundToPrecision)  # package Clockwork for Dynamo 1.x; Sets the width of a specified compound layer of a given family type (only applies to family types that have a compound structure, e.g. walls, floors etc.).
byCurveAndLevels = Wall.ByCurveAndLevels(c=extendStart, startLevel=base_constraint, endLevel=top_constraint, wallType=setCompoundLayerWidth.familyType)
